# Dynamo graph 10222017.CreatePads.WithDetailLine.00.dyn (Dynamo 1.3.2.2480)

select_model_element = DSModelElementSelection()  # 1 picked in the model
curves = Element.Curves(select_model_element)
code_block = CodeBlock { 15; }
divideCurveByDistance = Geometry.Curves.DivideCurveByDistance(curves, code_block)
byPoints = PolyCurve.ByPoints(points=divideCurveByDistance)
explode = Geometry.Explode(byPoints)
flatten = Flatten(explode)
number_slider = DoubleSlider(26, range=0..100 step 0.1)
byCoordinates = Vector.ByCoordinates(y=number_slider)
translate = Geometry.Translate(geometry=explode, direction=byCoordinates)
flatten_2 = Flatten(translate)
create = List.Create(flatten, flatten_2)
transpose = List.Transpose(create)
watch = Watch(transpose)
byLoft = Surface.ByLoft(transpose)
perimeterCurves = Surface.PerimeterCurves(byLoft)
vertices = Face.Vertices(byLoft)
pointGeometry = Vertex.PointGeometry(vertices)
number_slider_2 = DoubleSlider(2, range=0..4 step 1)
shiftIndices = List.ShiftIndices(list=pointGeometry, amount=number_slider_2)
family_types = FamilyTypes("RevilationPad:RevilationPad")
byPoints_2 = AdaptiveComponent.ByPoints(points=shiftIndices, familyType=family_types)
