# Dynamo graph Clear Parent-Child IDs.dyn (Dynamo 1.3.2.2480)

# group: Select Objects
select_children = DSModelElementsSelection()  # 1 picked in the model

code_block = CodeBlock { ""; }

# group: Add new Children IDs to parent
code_block_2 = CodeBlock { "Child IDs"; }
setParameterByName = Element.SetParameterByName(element=select_children, parameterName=code_block_2, value=code_block)

# group: Clear Parent ID in all Children
code_block_3 = CodeBlock { "Parent IDs"; }
setParameterByName_2 = Element.SetParameterByName(element=select_children, parameterName=code_block_3, value=code_block)
