# Dynamo graph Create Pads.dyn (Dynamo 1.3.2.2480)

select_model_element = DSModelElementSelection()  # 1 picked in the model
curves = Element.Curves(select_model_element)
number_slider = DoubleSlider(25, range=1..100 step 1)
byCoordinates = Vector.ByCoordinates(y=number_slider)
translate = Geometry.Translate(geometry=curves, direction=byCoordinates)
create = List.Create(curves, translate)
flatten = Flatten(create)
byLoft = Surface.ByLoft(flatten)
code_block = CodeBlock { 15; }
divideCurveByDistance = Geometry.Curves.DivideCurveByDistance(curves, code_block)
divideCurveByDistance_2 = Geometry.Curves.DivideCurveByDistance(translate, code_block)
byStartPointEndPoint = Line.ByStartPointEndPoint(startPoint=divideCurveByDistance.out0, endPoint=divideCurveByDistance_2)
code_block_2 = CodeBlock { 1; }
byCoordinates_2 = Vector.ByCoordinates(z=code_block_2)
extrude = Curve.Extrude(byStartPointEndPoint, byCoordinates_2)
code_block_3 = CodeBlock { -1; }
byCoordinates_3 = Vector.ByCoordinates(z=code_block_3)
extrude_2 = Curve.Extrude(byStartPointEndPoint, byCoordinates_3)
create_2 = List.Create(extrude, extrude_2)
byJoinedSurfaces = PolySurface.ByJoinedSurfaces(create_2)
split = Geometry.Split(geometry=byLoft, other=byJoinedSurfaces)
flatten_2 = Flatten(split)
vertices = Face.Vertices(flatten_2)
pointGeometry = Vertex.PointGeometry(vertices)
family_types = FamilyTypes("room_Pad:room_Pad")
byPoints = AdaptiveComponent.ByPoints(points=pointGeometry, familyType=family_types)
watch = Watch(divideCurveByDistance.out3)
length = Curve.Length(curves)
watch_2 = Watch(length)
code_block_4 = CodeBlock { 8565; }
select_model_element_2 = DSModelElementSelection()  # 1 picked in the model
string = StringInput("ChildrenIDs")
getParameterValueByName = Element.GetParameterValueByName(element=select_model_element_2, parameterName=string)
code_block_5 = CodeBlock { ","; }
split_2 = String.Split(getParameterValueByName, code_block_5)
byElementId = archilab.Revit.Selection.Select.ByElementId(split_2)
watch_3 = Watch(byElementId)
watch_4 = Watch(split_2)
addItemToFront = List.AddItemToFront(item=select_model_element_2, list=byElementId)
watch_5 = Watch(addItemToFront)
olive = Custom[Color.Olive]()  # Returns the colour olive.
navy = Custom[Color.Navy]()  # Returns the colour navy.
purple = Custom[Color.Purple]()  # Returns the colour purple.
create_3 = List.Create(olive, navy, purple)
code_block_6 = CodeBlock { {0,1,2}; }
code_block_7 = CodeBlock { 0; 0.65; 1; }
create_4 = List.Create(code_block_7.out0, code_block_7.out1, code_block_7.out2)
color_range = ColorRange(create_3, code_block_6, create_4)
overrideColorInView = Element.OverrideColorInView(element=watch_5, color=color_range)
count = List.Count(addItemToFront)
