# Dynamo graph Recreate Room 2.0.dyn (Dynamo 1.3.2.2480)

select_model_element = DSModelElementSelection()  # 1 picked in the model
select_model_elements = DSModelElementsSelection()  # 4 picked in the model
code_block = CodeBlock { "Guide To Follow"; }
getParameterValueByName = Element.GetParameterValueByName(element=select_model_elements, parameterName=code_block)
byElementId = Archilab.Grimshaw.Selection.Select.ByElementId(getParameterValueByName)
code_block_2 = CodeBlock { "Ids To Mimic"; }
getParameterValueByName_2 = Element.GetParameterValueByName(element=byElementId, parameterName=code_block_2)
code_block_3 = CodeBlock { ","; }
split = String.Split(getParameterValueByName_2, code_block_3)
byElementId_2 = Archilab.Grimshaw.Selection.Select.ByElementId(split)
type = Archilab.Grimshaw.Elements.Element.Type(byElementId_2)
getLocation = Element.GetLocation(select_model_elements)
getLocation_2 = Element.GetLocation(byElementId)
getLocation_3 = Element.GetLocation(byElementId_2)
byTwoPoints = Vector.ByTwoPoints(start=getLocation_2, end=getLocation_3)
translate = Geometry.Translate(geometry=getLocation, direction=byTwoPoints)
ZAxis = Vector.ZAxis()

# group: rotation around origin point
facingOrientation = FamilyInstance.FacingOrientation(select_model_elements)
facingOrientation_2 = FamilyInstance.FacingOrientation(byElementId)
ZAxis_2 = Vector.ZAxis()
angleAboutAxis = Vector.AngleAboutAxis(facingOrientation, facingOrientation_2, ZAxis_2)

rotate = Geometry.Rotate(geometry=translate, origin=getLocation, axis=ZAxis, degrees=angleAboutAxis)
byPoint = FamilyInstance.ByPoint(familyType=type, point=rotate)
facingOrientation_3 = FamilyInstance.FacingOrientation(byElementId_2)
facingOrientation_4 = FamilyInstance.FacingOrientation(byElementId)
ZAxis_3 = Vector.ZAxis()
angleAboutAxis_2 = Vector.AngleAboutAxis(facingOrientation_3, facingOrientation_4, ZAxis_3)
add = angleAboutAxis + angleAboutAxis_2
setRotation = FamilyInstance.SetRotation(familyInstance=byPoint, degree=add)
code_block_4 = CodeBlock { "Mimicry Of"; }
setParameterByName = Element.SetParameterByName(parameterName=code_block_4)  # unwired: element, value
totalTransform = Custom[FamilyInstance.TotalTransform](FamilyInstance=byElementId)  # This node returns a Total Transform of a family instance.
toPoint = Custom[Transform.ToPoint](Transform=totalTransform)  # This node takes a Transform and an input point that will be translated by the Transform.; unwired: Point
totalTransform_2 = Custom[FamilyInstance.TotalTransform](FamilyInstance=select_model_elements)
transform = CoordinateSystem.Transform()  # unwired: arg0, arg1, arg2
transform_2 = CoordinateSystem.Transform()  # unwired: arg0, arg1
python_script_multiply_transform = Python()  # unwired: IN[0]
# ---------- python_script_multiply_transform.python (40 lines) ----------
import clr

clr.AddReference('RevitServices')
import RevitServices
from RevitServices.Persistence import DocumentManager
from RevitServices.Transactions import TransactionManager

# Import RevitAPI
clr.AddReference('RevitAPI')
clr.AddReference('RevitAPIUI')
import Autodesk
from Autodesk.Revit.DB import *
 
import clr
clr.AddReference('ProtoGeometry')
from Autodesk.DesignScript.Geometry import *

clr.AddReference('RevitNodes')
# Import ToDSType(bool) extension method
import Revit
clr.ImportExtensions(Revit.Elements)

doc = DocumentManager.Instance.CurrentDBDocument
app = DocumentManager.Instance.CurrentUIApplication.Application
uidoc = DocumentManager.Instance.CurrentUIDocument

'''
UnwrapElement([revitelement])
.ToDSType(t/f)  True if originated in Revit; false if created by script
TransactionManager.Instance.EnsureInTransaction(doc)
TransactionManager.Instance.TransactionTaskDone()
'''

#The inputs to this node will be stored as a list in the IN variables.
dataEnteringNode = IN

IN[0]

#Assign your output to the OUT variable.
OUT = 0
# ----------------------------------------
