# Dynamo graph Recreate Room 2.1.dyn (Dynamo 1.3.2.2480)

select_model_element = DSModelElementSelection()  # 1 picked in the model
boolean = BoolSelector(true)
pick_model_elements = Custom[Pick Model Elements](refresh=boolean)  # This node offers a pick method for selecting elements in Revit.
code_block = CodeBlock { "Guide To Follow"; }
getParameterValueByName = Element.GetParameterValueByName(element=pick_model_elements, parameterName=code_block)
byElementId = archilab.Revit.Selection.Select.ByElementId(getParameterValueByName)
code_block_2 = CodeBlock { "Ids To Mimic"; }
getParameterValueByName_2 = Element.GetParameterValueByName(element=byElementId, parameterName=code_block_2)
code_block_3 = CodeBlock { ","; }
split = String.Split(getParameterValueByName_2, code_block_3)
byElementId_2 = archilab.Revit.Selection.Select.ByElementId(split)
type = Custom[Element.Type](element=byElementId_2)  # This retrieves the element type of the given elements. (if available) Similar to others available but no python here.
getLocation = Element.GetLocation(pick_model_elements)
getLocation_2 = Element.GetLocation(byElementId)
getLocation_3 = Element.GetLocation(byElementId_2)
byTwoPoints = Vector.ByTwoPoints(start=getLocation_2, end=getLocation_3)
translate = Geometry.Translate(geometry=getLocation, direction=byTwoPoints)
ZAxis = Vector.ZAxis()

# group: rotation around origin point
facingOrientation = FamilyInstance.FacingOrientation(pick_model_elements)
facingOrientation_2 = FamilyInstance.FacingOrientation(byElementId)
ZAxis_2 = Vector.ZAxis()
angleAboutAxis = Vector.AngleAboutAxis(facingOrientation, facingOrientation_2, ZAxis_2)

rotate = Geometry.Rotate(geometry=translate, origin=getLocation, axis=ZAxis, degrees=angleAboutAxis)
byPoint = FamilyInstance.ByPoint(familyType=type, point=rotate)
facingOrientation_3 = FamilyInstance.FacingOrientation(byElementId_2)
facingOrientation_4 = FamilyInstance.FacingOrientation(byElementId)
ZAxis_3 = Vector.ZAxis()
angleAboutAxis_2 = Vector.AngleAboutAxis(facingOrientation_3, facingOrientation_4, ZAxis_3)
add = angleAboutAxis + angleAboutAxis_2
setRotation = FamilyInstance.SetRotation(familyInstance=byPoint, degree=add)
code_block_4 = CodeBlock { "Mimicry Of"; }
setParameterByName = Element.SetParameterByName(parameterName=code_block_4)  # unwired: element, value
totalTransform = Custom[FamilyInstance.TotalTransform](FamilyInstance=byElementId)  # This node returns a Total Transform of a family instance.
toPoint = Custom[Transform.ToPoint](Transform=totalTransform)  # This node takes a Transform and an input point that will be translated by the Transform.; unwired: Point
transform = CoordinateSystem.Transform()  # unwired: arg0, arg1, arg2
type_2 = archilab.Revit.Elements.WarningElement.Type()  # unwired: arg0
watch = Watch(type)
watch_2 = Watch(byElementId_2)
watch_3 = Watch(pick_model_elements)
code_block_5 = CodeBlock { "Ids To Mimic"; }
getParameterValueByName_3 = Element.GetParameterValueByName(parameterName=code_block_5)  # unwired: element
code_block_6 = CodeBlock { "359494,359600,359946,361638,362969,363067"; }
setParameterByName_2 = Element.SetParameterByName(parameterName=code_block_5, value=code_block_6)  # unwired: element
watch_4 = Watch(setParameterByName_2)
