# Dynamo graph Recreate Room 2.2.dyn (Dynamo 1.3.2.2480)

code_block = CodeBlock { "Ids To Mimic"; }
boolean = BoolSelector(true)
pick_model_elements = Custom[Pick Model Elements](refresh=boolean)  # This node offers a pick method for selecting elements in Revit.
code_block_2 = CodeBlock { "Guide To Follow"; }
getParameterValueByName = Element.GetParameterValueByName(element=pick_model_elements, parameterName=code_block_2)
byElementId = archilab.Revit.Selection.Select.ByElementId(getParameterValueByName)
code_block_3 = CodeBlock { "ChildrenIDs"; }
getParameterValueByName_2 = Element.GetParameterValueByName(element=byElementId, parameterName=code_block_3)
code_block_4 = CodeBlock { {","}; }
split = String.Split(getParameterValueByName_2, code_block_4)
byElementId_2 = archilab.Revit.Selection.Select.ByElementId(split)
flatten = Flatten(byElementId_2)
type = Custom[Element.Type](element=flatten)  # This retrieves the element type of the given elements. (if available) Similar to others available but no python here.
getLocation = Element.GetLocation(pick_model_elements)
getLocation_2 = Element.GetLocation(byElementId)
getLocation_3 = Element.GetLocation(flatten)
byTwoPoints = Vector.ByTwoPoints(start=getLocation_2, end=getLocation_3, lacing=CrossProduct)
translate = Geometry.Translate(geometry=getLocation, direction=byTwoPoints)
ZAxis = Vector.ZAxis()

# group: rotation around origin point
facingOrientation = FamilyInstance.FacingOrientation(pick_model_elements)
facingOrientation_2 = FamilyInstance.FacingOrientation(byElementId)
ZAxis_2 = Vector.ZAxis()
angleAboutAxis = Vector.AngleAboutAxis(facingOrientation, facingOrientation_2, ZAxis_2)

rotate = Geometry.Rotate(geometry=translate, origin=getLocation, axis=ZAxis, degrees=angleAboutAxis)
byPoint = FamilyInstance.ByPoint(familyType=type, point=rotate)
facingOrientation_3 = FamilyInstance.FacingOrientation(flatten)
facingOrientation_4 = FamilyInstance.FacingOrientation(byElementId)
ZAxis_3 = Vector.ZAxis()
angleAboutAxis_2 = Vector.AngleAboutAxis(facingOrientation_3, facingOrientation_4, ZAxis_3)
add = angleAboutAxis + angleAboutAxis_2
setRotation = FamilyInstance.SetRotation(familyInstance=byPoint, degree=add)
type_2 = archilab.Revit.Elements.WarningElement.Type()  # unwired: arg0
watch = Watch(type)
watch_2 = Watch(split)
watch_3 = Watch(pick_model_elements)
