# Dynamo graph Revalation.Vis.Data.dyn (Dynamo 1.3.2.2480)

select_model_elements = DSModelElementsSelection()  # 1 picked in the model
string = StringInput("ChildrenIDs")
getParameterValueByName = Element.GetParameterValueByName(element=select_model_elements, parameterName=string)
code_block = CodeBlock { ","; }
split = String.Split(getParameterValueByName, code_block)
byElementId = archilab.Revit.Selection.Select.ByElementId(split)
watch = Watch(byElementId)
addItemToFront = List.AddItemToFront(item=select_model_elements, list=watch)
watch_2 = Watch(addItemToFront)
blue = Custom[Color.Blue]()  # Returns the colour blue.
red = Custom[Color.Red]()  # Returns the colour red.
lime = Custom[Color.Lime]()  # Returns the colour lime.
create = List.Create(blue, red, lime)
code_block_2 = CodeBlock { {0,1}; }
code_block_3 = CodeBlock { 0; 0.65; 1; }
create_2 = List.Create(code_block_3.out0, code_block_3.out1, code_block_3.out2)
color_range = ColorRange(create, code_block_2, create_2)
overrideColorInView = Element.OverrideColorInView(element=watch_2, color=color_range)
watch_3 = Watch(split)
watch_4 = Watch(select_model_elements)
count = List.Count(addItemToFront, lacing=CrossProduct)
watch_5 = Watch(count)

# group: dont connect this unless you have more than one generation of children
count_2 = List.Count(addItemToFront)
ofRepeatedItem = List.OfRepeatedItem(item=color_range, amount=count_2)
watch_6 = Watch(count_2)

all_elements_in_active_view = ElementsInView()
name = Family.Name(all_elements_in_active_view)
watch_7 = Watch(name)
