# Dynamo graph Revilations Updater 1.0.dyn (Dynamo 1.3.2.2480)

boolean = BoolSelector(true)
pick_model_elements = Custom[Pick Model Elements](refresh=boolean)  # This node offers a pick method for selecting elements in Revit.
watch = Watch(pick_model_elements)
code_block = CodeBlock { "RevilationsParents"; }
getParameterValueByName = Element.GetParameterValueByName(element=pick_model_elements, parameterName=code_block)
code_block_2 = CodeBlock(z=getParameterValueByName) { z!=""; }
filterByBoolMask = List.FilterByBoolMask(list=pick_model_elements, mask=code_block_2)
watch_2 = Watch(filterByBoolMask.in)
filterByBoolMask_2 = List.FilterByBoolMask(list=getParameterValueByName, mask=code_block_2)
byElementId = archilab.Revit.Selection.Select.ByElementId(filterByBoolMask_2.in)
getLocation = Element.GetLocation(byElementId)
X = Point.X(getLocation)
code_block_3 = CodeBlock { "RevilationsX"; }
getParameterValueByName_2 = Element.GetParameterValueByName(element=byElementId, parameterName=code_block_3)
toNumber = String.ToNumber(getParameterValueByName_2)
sub = X - toNumber
Y = Point.Y(getLocation)
code_block_4 = CodeBlock { "RevilationsY"; }
getParameterValueByName_3 = Element.GetParameterValueByName(element=byElementId, parameterName=code_block_4)
toNumber_2 = String.ToNumber(getParameterValueByName_3)
sub_2 = Y - toNumber_2
code_block_5 = CodeBlock { 0; }
byCoordinates = Vector.ByCoordinates(x=sub, y=sub_2, z=code_block_5)
watch_3 = Watch(byCoordinates)
watch_4 = Watch(byCoordinates)
stringToPoint = Geometry.Points.StringToPoint()  # unwired: arg0
getLocation_2 = Element.GetLocation(filterByBoolMask.in)
translate = Geometry.Translate(geometry=getLocation_2, direction=byCoordinates)
setLocation = Element.SetLocation(filterByBoolMask.in, translate)
select_model_elements = DSModelElementsSelection()
code_block_6 = CodeBlock { "RevilationsX"; }
string_from_object = FromObject(X)
setParameterByName = Element.SetParameterByName(element=byElementId, parameterName=code_block_6, value=string_from_object)
code_block_7 = CodeBlock { "RevilationsY"; }
string_from_object_2 = FromObject(Y)
setParameterByName_2 = Element.SetParameterByName(element=byElementId, parameterName=code_block_7, value=string_from_object_2)
