# Dynamo graph Revilations_R04.dyn (Dynamo 1.3.2.2480)

select_model_elements = DSModelElementsSelection()  # 9 picked in the model
code_block = CodeBlock { "Parent"; }
getParameterValueByName = Element.GetParameterValueByName(element=select_model_elements, parameterName=code_block)
code_block_2 = CodeBlock(z=getParameterValueByName) { z=="Master Parent"; }

# group: Master Parent Childeren Update
filterByBoolMask = List.FilterByBoolMask(list=select_model_elements, mask=code_block_2)
code_block_3 = CodeBlock { "Children"; }
getParameterValueByName_2 = Element.GetParameterValueByName(element=filterByBoolMask.in, parameterName=code_block_3)
code_block_4 = CodeBlock { ","; }
split = String.Split(getParameterValueByName_2, code_block_4)
flatten = Flatten(split)
toNumber = String.ToNumber(flatten)
python_script = Python(IN[0]=toNumber)
# ---------- python_script.python (27 lines) ----------
import clr
clr.AddReference('RevitAPI')
from Autodesk.Revit.DB import *

clr.AddReference("RevitNodes")
import Revit
clr.ImportExtensions(Revit.Elements)

clr.AddReference("RevitServices")
import RevitServices
from RevitServices.Persistence import DocumentManager

doc = DocumentManager.Instance.CurrentDBDocument

coll = FilteredElementCollector(doc).OfCategory(BuiltInCategory.OST_GenericModel).WhereElementIsNotElementType().ToElements()

items = UnwrapElement(IN[0])
elementlist = list()
unmatched = list()
out = []
for e in coll:
	for i in items:
		if i.ToString() == e.Id.ToString():
			out.append(e)
	

OUT = out
# ----------------------------------------
getLocation = Element.GetLocation(filterByBoolMask.in)
X = Point.X(getLocation)
code_block_5 = CodeBlock { "X Translate"; "Y Translate"; }
getParameterValueByName_3 = Element.GetParameterValueByName(element=python_script, parameterName=code_block_5.out0)
add = X + getParameterValueByName_3  # lacing=Longest
Y = Point.Y(getLocation)
getParameterValueByName_4 = Element.GetParameterValueByName(element=python_script, parameterName=code_block_5.out1)
add_2 = Y + getParameterValueByName_4  # lacing=Longest
Z = Point.Z(getLocation)
count = List.Count(add_2)
cycle = List.Cycle(list=Z, amount=count)
byCoordinates = Point.ByCoordinates(x=add, y=add_2, z=cycle)
setLocation = Element.SetLocation(python_script, byCoordinates)

# group: Parent Update Locations relative to Master Parents
code_block_6 = CodeBlock(z=getParameterValueByName) { z=="Parent"; }
filterByBoolMask_2 = List.FilterByBoolMask(list=select_model_elements, mask=code_block_6)
code_block_7 = CodeBlock { "X Translate"; "Y Translate"; }
getParameterValueByName_5 = Element.GetParameterValueByName(element=filterByBoolMask_2.in, parameterName=code_block_7.out0)
add_3 = X + getParameterValueByName_5  # lacing=Longest
getParameterValueByName_6 = Element.GetParameterValueByName(element=filterByBoolMask_2.in, parameterName=code_block_7.out1)
add_4 = Y + getParameterValueByName_6  # lacing=Longest
getLocation_2 = Element.GetLocation(filterByBoolMask_2.in)
Z_2 = Point.Z(getLocation_2)
byCoordinates_2 = Point.ByCoordinates(x=add_3, y=add_4, z=Z_2)
setLocation_2 = Element.SetLocation(filterByBoolMask_2.in, byCoordinates_2)

# group: Childerens Update Relative to Parents
code_block_8 = CodeBlock { null; }
if_ = If(test=byCoordinates_2, true=filterByBoolMask_2.in, false=code_block_8)
code_block_9 = CodeBlock { "Children"; }
getParameterValueByName_7 = Element.GetParameterValueByName(element=if_, parameterName=code_block_9)
code_block_10 = CodeBlock { ","; }
split_2 = String.Split(getParameterValueByName_7, code_block_10)
toNumber_2 = String.ToNumber(split_2)
python_script_2 = Python(IN[0]=toNumber_2)
# ---------- python_script_2.python (32 lines) ----------
import clr
clr.AddReference('RevitAPI')
from Autodesk.Revit.DB import *

clr.AddReference("RevitNodes")
import Revit
clr.ImportExtensions(Revit.Elements)

clr.AddReference("RevitServices")
import RevitServices
from RevitServices.Persistence import DocumentManager

doc = DocumentManager.Instance.CurrentDBDocument

coll = FilteredElementCollector(doc).OfCategory(BuiltInCategory.OST_GenericModel).WhereElementIsNotElementType().ToElements()

items = UnwrapElement(IN[0])
elementlist = list()
unmatched = list()
out = []
sd =[]

for lst in items:
	elist = []
	for e in lst:
		
		for i in coll:
			if i.Id.ToString() == e.ToString():
				elist.append(i)
	out.append(elist)
			
OUT = out
# ----------------------------------------
code_block_11 = CodeBlock { "X Translate"; "Y Translate"; }
getParameterValueByName_8 = Element.GetParameterValueByName(element=python_script_2, parameterName=code_block_11.out0)
getParameterValueByName_9 = Element.GetParameterValueByName(element=python_script_2, parameterName=code_block_11.out1)
getLocation_3 = Element.GetLocation(if_)
Z_3 = Point.Z(getLocation_3)
code_block_12 = CodeBlock(x=Z_3) { x[0]; }
Y_2 = Point.Y(getLocation_3)
add_5 = Y_2 + getParameterValueByName_9  # lacing=Longest
count_2 = List.Count(add_5)
cycle_2 = List.Cycle(list=code_block_12, amount=count_2)
X_2 = Point.X(getLocation_3)
add_6 = X_2 + getParameterValueByName_8  # lacing=Longest
byCoordinates_3 = Point.ByCoordinates(x=add_6, y=add_5, z=cycle_2)

getLocation_4 = Element.GetLocation(if_)
X_3 = Point.X(getLocation_4)
add_7 = X_3 + getParameterValueByName_8  # lacing=Longest
Y_3 = Point.Y(getLocation_4)
add_8 = Y_3 + getParameterValueByName_9  # lacing=Longest
byCoordinates_4 = Point.ByCoordinates(x=add_7, y=add_8, z=cycle_2)

# group (continued): Childerens Update Relative to Parents
setLocation_3 = Element.SetLocation(python_script_2, byCoordinates_4)
