# Dynamo graph Room Layout From Details.dyn (Dynamo 1.3.2.2480)

code_block = CodeBlock { "ID"; }
code_block_2 = CodeBlock { 1; 10; }
range = Range(start=code_block_2.out0, end=code_block_2.out1, step=code_block_2.out0, lacing=Longest)
code_block_3 = CodeBlock(a=code_block, b=range) { a+b; }
watch = Watch(code_block_3)
code_block_4 = CodeBlock { "Family ID"; }
parameter_types = ParameterTypeUi("Text")
select_builtin_parameter_group = BuiltInParameterGroup("PG_IDENTITY_DATA")
boolean = BoolSelector(true)
categories = Categories("Mass")
createSharedParameter = Parameter.CreateSharedParameter(watch, code_block_4, parameter_types, select_builtin_parameter_group, boolean, categories)
watch_2 = Watch(createSharedParameter)
createProjectParameter = Parameter.CreateProjectParameter()  # unwired: arg0, arg1, arg2, arg3, arg4, arg5
select_model_elements = DSModelElementsSelection()  # 1 picked in the model
coreBoundary = Room.CoreBoundary(select_model_elements)
watch_3 = Watch(coreBoundary)
location = Room.Location(select_model_elements)
n3DRoomTags = Custom[Rhythm.3DRoomTags]()  # This node will generate 3D room tags for all rooms in the model. (RFA in extra folder in Dynamo download); unwired: ThreeDRoomTag, Phase
isInsideRoom = Room.IsInsideRoom()  # unwired: arg0, arg1
centerBoundary = Room.CenterBoundary(select_model_elements)
watch_4 = Watch(centerBoundary)
centerBoundary_2 = Room.CenterBoundary(select_model_elements)
boundaries = Custom[Room.Boundaries](Room=select_model_elements)  # This node returns all Room bounding curves and elements that generated them (walls, separation lines etc).
levels = Levels("T.O. FOOTING")
select_model_elements_2 = DSModelElementsSelection()  # 4 picked in the model
name = Element.Name(select_model_elements_2)
watch_5 = Watch(name)
code_block_5 = CodeBlock(A=watch_5) { A == "Detail Lines"; }
filterByBoolMask = List.FilterByBoolMask(list=select_model_elements_2, mask=code_block_5)
curve = DetailCurve.Curve(filterByBoolMask.in)
endPoint = Curve.EndPoint(curve)
byPoints = Polygon.ByPoints(endPoint)
center = Polygon.Center(byPoints)
type_of_model_space = CodeBlock { "Namebb"; }
code_block_6 = CodeBlock { "12"; }
byLocation = Room.ByLocation(levels, center, type_of_model_space, code_block_6)
finishBoundary = Room.FinishBoundary(byLocation)
coreBoundary_2 = Room.CoreBoundary(select_model_elements)
area = Room.Area(select_model_elements)
coreCenterBoundary = Room.CoreCenterBoundary(select_model_elements)
setName = Room.SetName()  # unwired: arg0, arg1
location_2 = Room.Location(byLocation)
code_block_7 = CodeBlock { 12; }
wall_types = WallTypes("10\" Concrete")
byCurveAndHeight = Wall.ByCurveAndHeight(curve=curve, height=code_block_7, level=levels, wallType=wall_types)
