# Dynamo graph Select Element by IDs.dyn (Dynamo 1.2.2.373)

select_model_elements = DSModelElementsSelection()
id = Element.Id(select_model_elements)
python_script = Python(IN[0]=id)
# ---------- python_script.python (46 lines) ----------
import clr
clr.AddReference('ProtoGeometry')
from Autodesk.DesignScript.Geometry import *

# Import DocumentManager
clr.AddReference("RevitServices")
import RevitServices
from RevitServices.Persistence import DocumentManager

# Import RevitAPI
clr.AddReference("RevitAPI")
import Autodesk

# Import ToDSType(bool) extension method
clr.AddReference("RevitNodes")
import Revit
clr.ImportExtensions(Revit.Elements)

#The inputs to this node will be stored as a list in the IN variable.
dataEnteringNode = IN
doc = DocumentManager.Instance.CurrentDBDocument
#doc = IN[1]
#unwrap incoming information for use with API
ids = []
for i in IN[0]:
    ids.append(UnwrapElement(i))
#use element ids to select elements
elements = []
for i in ids:
	#check if id is string
	if isinstance(i, str) and len(i) <= 7:
		idInt = int(i)
		elemId = Autodesk.Revit.DB.ElementId(idInt)
		elements.append(doc.GetElement(elemId).ToDSType(True))
	elif isinstance(i, int):
		elemId = Autodesk.Revit.DB.ElementId(i)
		elements.append(doc.GetElement(elemId).ToDSType(True))
	elif isinstance(i, Autodesk.Revit.DB.ElementId):
		elements.append(doc.GetElement(i).ToDSType(True))
	elif isinstance(i, str) and len(i) >= 8:
		elements.append(doc.GetElement(i).ToDSType(True))
	else:
		OUT = "invalid input"

#Assign your output to the OUT variable
OUT = elements
# ----------------------------------------
