# Dynamo graph Set Guide To Follow.dyn (Dynamo 1.3.2.2480)

# group: Select Copies
select_copies = DSModelElementsSelection()  # 4 picked in the model

code_block = CodeBlock { "; "; }

# group: Select Guide
select_guide = DSModelElementSelection()  # 1 picked in the model

id = Element.Id(select_guide)
string_from_object = FromObject(id)
join = String.Join(code_block, string_from_object)

# group: Add new GuideID to all copied guides
code_block_2 = CodeBlock { "Guide To Follow"; }
setParameterByName = Element.SetParameterByName(element=select_copies, parameterName=code_block_2, value=join)
