# Dynamo graph Set IDs to Mimic.dyn (Dynamo 1.3.2.2480)

# group: Select Parent
select_parent = DSModelElementSelection()  # 1 picked in the model

code_block = CodeBlock { "Ids To Mimic"; }
code_block_2 = CodeBlock { "; "; }
code_block_3 = CodeBlock { "Ids To Mimic"; }
getParameterValueByName = Element.GetParameterValueByName(element=select_parent, parameterName=code_block_3)
code_block_4 = CodeBlock { "; "; }
select_items_to_reference = DSModelElementsSelection()  # 4 picked in the model
id = Element.Id(select_items_to_reference)
string_from_object = FromObject(id)
join = String.Join(code_block_4, string_from_object)
join_2 = String.Join(code_block_2, getParameterValueByName, join)

# group: Add new Children IDs to parent
setParameterByName = Element.SetParameterByName(element=select_parent, parameterName=code_block, value=join_2)
code_block_5 = CodeBlock { "ChildrenIDs"; }
