# Dynamo graph Set Parent-Child IDs.dyn (Dynamo 1.3.2.2480)

# group: Select Parent
select_parent = DSModelElementSelection()  # 1 picked in the model

code_block = CodeBlock { "; "; }
code_block_2 = CodeBlock { "ChildrenIDs"; }
getParameterValueByName = Element.GetParameterValueByName(element=select_parent, parameterName=code_block_2)
code_block_3 = CodeBlock { "; "; }
select_model_elements = DSModelElementsSelection()  # 5 picked in the model
id = Element.Id(select_model_elements)
string_from_object = FromObject(id)
join = String.Join(code_block_3, string_from_object)
join_2 = String.Join(code_block, getParameterValueByName, join)

# group: Add new Children IDs to parent
code_block_4 = CodeBlock { "ChildrenIDs"; }
setParameterByName = Element.SetParameterByName(element=select_parent, parameterName=code_block_4, value=join_2)

code_block_5 = CodeBlock { "; "; }
id_2 = Element.Id(select_parent)
string_from_object_2 = FromObject(id_2)
join_3 = String.Join(code_block_5, string_from_object_2)

# group: Update Parent ID in all Children
code_block_6 = CodeBlock { "ParentIDs"; }
setParameterByName_2 = Element.SetParameterByName(element=select_model_elements, parameterName=code_block_6, value=join_3)

# group: Select Child
select_child = DSModelElementSelection()  # 1 picked in the model

code_block_7 = CodeBlock { "Guide Name"; }
getParameterValueByName_2 = Element.GetParameterValueByName(element=select_parent, parameterName=code_block_7)

# group: Update Guide Name in all children
code_block_8 = CodeBlock { "Guide Name"; }
setParameterByName_3 = Element.SetParameterByName(element=select_model_elements, parameterName=code_block_8, value=getParameterValueByName_2)
