# Dynamo graph Create Diagnostic View.dyn (Dynamo 1.3.1.1736)

# group: Script Notes
# note: TITLE: Create Diagnostic View
# CREATED BY: Smith Group Team
# Dynamo Version: 1.3
# VERSION: 1.0
# PACKAGES:  Clockwork
# NOTES:

# group: Create a Bounding Box
code_block = CodeBlock { -10; 10; }
byCoordinates = Point.ByCoordinates(x=code_block.out1, y=code_block.out1, z=code_block.out1)
byCoordinates_2 = Point.ByCoordinates(x=code_block.out0, y=code_block.out0, z=code_block.out0)
byCorners = BoundingBox.ByCorners(min=byCoordinates_2, max=byCoordinates)

# group: Get Existing View Names
element_types = ElementTypes("View")
all_elements_of_type = ElementsOfType(element_types)
name = Element.Name(all_elements_of_type)

# group: Create View Name
code_block_2 = CodeBlock { "Diagnostic-"; }
os_user_name_from_rhythm = Python()
# ---------- os_user_name_from_rhythm.python (8 lines) ----------
import clr
import sys

pyt_path = r'C:\Program Files (x86)\IronPython 2.7\Lib'
sys.path.append(pyt_path)

import os
OUT = os.environ.get( "USERNAME" )
# ----------------------------------------
add = code_block_2 + os_user_name_from_rhythm

# group: Filter For Existing View
containsItem = List.ContainsItem(list=name, item=add)
code_block_3 = CodeBlock { null; }
code_block_4 = CodeBlock { Point.ByCoordinates(0,0,0); }
if_ = If(test=containsItem, true=code_block_3, false=code_block_4)

# group: Create A 3D View
byEyePointTargetAndBoundingBox = AxonometricView.ByEyePointTargetAndBoundingBox(byCoordinates, if_, byCorners, add)
